# Grasshopper definition bridge_shell.ghx (Grasshopper 1.0.7)
# plug-ins: BitmapPlus

# ----
# Data
# Design Parameters
# Setup Dataset
# PerformanceAttributes
# Generate Samples
# Load Dataset
load_dataset = Button()
m = Panel("50 to 100")
panel = Panel("0.05 to 0.25")
panel_2 = Panel("1 to 5")
panel_3 = Panel("1 to 5")
panel_4 = Panel("0.05 to 0.25")
datasetgen = DatasetGenerator()  # -> instructions
#   port instructions: Information on how to run the `dataset_generator` script.
# ---------- datasetgen: Python ----------
"""Provides instructions on how to generate random samples for the dataset."""
from aixd_ara.scripts import dataset_generator

path = dataset_generator.__file__

txt = "INSTRUCTIONS\n------------\n"
txt += "How to generate random samples for the dataset.\n\n"
txt += "Locate the 'dataset_generator.py' file in:\n\n"
txt += "{}\n\n".format(path)
txt += "In Rhino, open the Rhino Pythin Editor, open the file and run it.\n"
txt += "(Follow the prompts in the Rhino command line)\n\n"
txt += "Optionally, add a button to a Rhino toolbar to access the dataset generator more easily:\n"


txt += "> right-click on a toolbar > New Button... \n"
txt += "> in the pop-up window, in Command section, paste:\n\n"
txt += "'! _-RunPythonScript {}'".format(path)

instructions = txt
# ---------- end datasetgen ----------
domain = Domain(m)
domain_2 = Domain(panel_4)
domain_3 = Domain(panel_3)
domain_4 = Domain(panel)
domain_5 = Domain(panel_2)
datareal = DataReal(name="span", domain=domain)  # -> dataobject; inputs dim: Int32
#   port name: Name of the variable.
#   port dim: Dimension of the variable.
#   port domain: Domain of the variable as an interval.
# ---------- datareal: Python ----------
"""Defines a real-valued variable."""
# flake8: noqa
from aixd_ara.wrappers import WrapperShallowDataObject

if not dim or dim < 1:
    dim = 1

if domain:
    domain = (float(domain.Min), float(domain.Max))
else:
    domain = None


dobj = {"datatype": "DataReal", "name": name, "dim": dim, "domain": domain}


dataobject = WrapperShallowDataObject(dobj)
# ---------- end datareal ----------
datareal_2 = DataReal(name="ws_ratio1", domain=domain_2)  # -> dataobject; inputs dim: Int32; same code as datareal
datareal_3 = DataReal(name="ws_ratio2", domain=domain_3)  # -> dataobject; inputs dim: Int32; same code as datareal
datareal_4 = DataReal(name="hs_ratio1", domain=domain_4)  # -> dataobject; inputs dim: Int32; same code as datareal
datareal_5 = DataReal(name="hs_ratio2", domain=domain_5)  # -> dataobject; inputs dim: Int32; same code as datareal
datareal_6 = DataReal(name="length")  # -> dataobject; inputs dim: Int32; same code as datareal
datareal_7 = DataReal(name="area")  # -> dataobject; inputs dim: Int32; same code as datareal
datareal_8 = DataReal(name="mass")  # -> dataobject; inputs dim: Int32; same code as datareal
datareal_9 = DataReal(name="displacement")  # -> dataobject; inputs dim: Int32; same code as datareal
datasetload = DatasetLoad(load=load_dataset)  # -> msg; inputs load: Boolean
#   port load: Set to True to load the dataset.
# ---------- datasetload: Python ----------
"""Loads an existing dataset from the file system, from the location specified in the project setup. It loads the dataset object and the data into the app."""
# flake8: noqa
from scriptcontext import sticky as st

from aixd_ara.gh_ui import load_dataset
from aixd_ara.gh_ui_helper import component_id
from aixd_ara.gh_ui_helper import session_id

cid = component_id(session_id(), ghenv.Component, "DatasetLoad")

if load:
    st[cid] = load_dataset(session_id())

if cid in st.keys():
    msg = st[cid]["msg"]
# ---------- end datasetload ----------
datasetsummary = DatasetSummary(get=Button())  # -> summary; inputs get: Boolean
#   port get: Set to True to get the summary of the dataset.
#   port summary: Summary of the dataset.
# ---------- datasetsummary: Python ----------
"""Provides a summary of the dataset."""
# flake8: noqa
from scriptcontext import sticky as st

from aixd_ara.gh_ui import dataset_summary
from aixd_ara.gh_ui_helper import component_id
from aixd_ara.gh_ui_helper import session_id

cid = component_id(session_id(), ghenv.Component, "DatasetSummary")

if get:
    st[cid] = dataset_summary(session_id())

if cid in st.keys():
    if st[cid]["msg"]:
        summary = st[cid]["msg"]  # error
    else:
        summary = st[cid]["summary"]
# ---------- end datasetsummary ----------
datasetonesample = DatasetOneSample(get=Button())  # -> sample_summary; inputs item: Int32, get: Boolean
#   port item: Index of the sample in the dataset, optional. If not provided, a random index will be selected.
#   port get: Set to True to retrieve a sample.
#   port sample_summary: Summary of the retrieved sample.
# ---------- datasetonesample: Python ----------
"""Retrieves one sample from the dataset (at a given or random index) and instantiates it in the parametric model."""
# flake8: noqa
from scriptcontext import sticky as st

from aixd_ara.gh_ui import get_one_sample
from aixd_ara.gh_ui_helper import component_id
from aixd_ara.gh_ui_helper import instantiate_sample, sample_summary
from aixd_ara.gh_ui_helper import session_id

cid = component_id(session_id(), ghenv.Component, "GetOneSample")


if not item:
    item = -1

if get:
    st[cid] = get_one_sample(session_id(), item)

ghdoc = ghenv.Component.OnPingDocument()


if cid in st.keys():
    sample = st[cid]
    instantiate_sample(ghdoc, sample)

    sample_summary = sample_summary(sample)
# ---------- end datasetonesample ----------
panel_5 = Panel(datasetgen)
panel_6 = Panel(datasetsummary)
panel_7 = Panel(datasetonesample)
panel_8 = Panel(datasetload)
merge = Merge(
    Data1=flatten(datareal),
    Data2=flatten(datareal_2),
    Data3=flatten(datareal_3),
    Data4=flatten(datareal_4),
    Data5=flatten(datareal_5))
merge_2 = Merge(Data1=flatten(datareal_6), Data2=flatten(datareal_7), Data3=flatten(datareal_8), Data4=datareal_9)
datasetcreate = DatasetCreate(design_parameters=flatten(merge), performance_attributes=merge_2, create=Button())  # -> msg; inputs design_parameters: list, performance_attributes: list, create: Boolean
#   port design_parameters: Design parameters: list of data objects.
#   port performance_attributes: Performance attributes: list of data objects.
#   port create: Set to True to create a dataset object. If a dataset already exists in the project path, nothing will happen. To create a new dataset, change the project path or dataset name or delete the existing dataset.
#   port msg: Message or error.
# ---------- datasetcreate: Python ----------
"""Creates a dataset object. This defines the structure of the dataset. It does not cointain any data."""
# flake8: noqa
from scriptcontext import sticky as st

from aixd_ara.gh_ui import create_dataset_object
from aixd_ara.gh_ui_helper import component_id
from aixd_ara.gh_ui_helper import session_id

cid = component_id(session_id(), ghenv.Component, "DatasetCreate")


design_parameters = [x.data for x in design_parameters]
performance_attributes = [x.data for x in performance_attributes]


if create:
    st[cid] = create_dataset_object(session_id(), design_parameters, performance_attributes)

if cid in st.keys():
    msg = st[cid]["msg"]
# ---------- end datasetcreate ----------
panel_9 = Panel(datasetcreate)
dataobjectsnames = DataObjectsNames(get_names=Button())  # inputs datablock: list, get_names: Boolean
#   port datablock: Name(s) of the datablock(s).
#   port get_names: Set to True to run.
# ---------- dataobjectsnames: Python ----------
"""Generates panels with list of names of data objects for all or selected data blocks. Data block names are: 'design_parameters','performance_attributes','inputML','outputML'. """
# flake8: noqa

# this code has been inspired by a forum post by "chanley" (2018.11.02)
# https://discourse.mcneel.com/t/can-i-instantiate-specific-component-on-the-canvas-with-a-script-python/74204/8

import Grasshopper
import System.Drawing as sd

from aixd_ara.gh_ui import get_dataobject_names_from_block
from aixd_ara.gh_ui_helper import session_id

comp = ghenv.Component
ghdoc = comp.OnPingDocument()


def make_Panel(NickName, UserText, Pivot, Bounds):
    try:
        Panel = Grasshopper.Kernel.Special.GH_Panel()
        Panel.NickName = NickName
        Panel.UserText = UserText
        Panel.Properties.Colour = sd.Color.White
        # Panel.Properties.Font = sd.Font("Trebuchet MS", 10)
        Panel.Properties.Multiline = False
        Panel.Properties.DrawIndices = False
        Panel.Properties.DrawPaths = False
        ghdoc.AddObject(Panel, False, ghdoc.ObjectCount + 1)
        Panel.Attributes.Pivot = Pivot
        Panel.Attributes.Bounds = Bounds
    except Exception(ex):
        ghenv.Component.AddRuntimeMessage(Grasshopper.Kernel.GH_RuntimeMessageLevel.Warning, str(ex))


x = ghenv.Component.Attributes.DocObject.Attributes.Bounds.Right
y = ghenv.Component.Attributes.DocObject.Attributes.Bounds.Top

w = 150
h = 150
gap = 50

errors = ""

if not datablock:
    datablock = ["design_parameters", "performance_attributes", "inputML", "outputML"]  # all datablock names

if get_names:

    for i, datablock_nickname in enumerate(datablock):
        panel_title = datablock_nickname
        response = get_dataobject_names_from_block(session_id(), datablock_nickname)
        text_items = response["names"]
        if text_items:
            text_str = "\n".join(text_items)
            pt = sd.PointF(x + gap + i * gap, y + i * gap)
            rect = sd.RectangleF(0, 0, w, h)
            make_Panel(panel_title, text_str, pt, rect)
        else:
            errors += response["msg"] + "\n"

if errors:
    ghenv.Component.AddRuntimeMessage(Grasshopper.Kernel.GH_RuntimeMessageLevel.Warning, str(errors))
# ---------- end dataobjectsnames ----------

# ----
# Project Setup
panel_10 = Panel("bridge_shell_dataset")
server = Server(start=Button())  # -> msg; inputs start: Boolean, stop: Boolean, show_window: Boolean
#   port start: Starts the server.
# ---------- server: Python ----------
from __future__ import absolute_import
from __future__ import division
from __future__ import print_function

import compas
import compas._os
from ghpythonlib.componentbase import executingcomponent as component
from scriptcontext import sticky as st

from aixd_ara.constants import DEFAULT_PORT

try:
    from subprocess import PIPE
    from subprocess import Popen
except ImportError:
    from System.Diagnostics import Process

import os

import aixd_ara as ag


class ApiRunner(object):
    def __init__(
        self,
        package=None,
        python=None,
        url="http://127.0.0.1",
        port=DEFAULT_PORT,
        service=None,
        max_conn_attempts=100,
        autoreload=True,
        capture_output=True,
        path=None,
        working_directory=None,
    ):
        self.python = compas._os.select_python(python)
        self.service = "aixd_ara.api"
        self.working_directory = working_directory
        self.capture_output = capture_output
        self.port = port

        self.start_server()

    def start_server(self):
        env = compas._os.prepare_environment()

        try:
            Popen

        except NameError:
            self._process = Process()
            for name in env:
                if self._process.StartInfo.EnvironmentVariables.ContainsKey(name):
                    self._process.StartInfo.EnvironmentVariables[name] = env[name]
                else:
                    self._process.StartInfo.EnvironmentVariables.Add(name, env[name])
            self._process.StartInfo.UseShellExecute = True
            self._process.StartInfo.RedirectStandardOutput = self.capture_output
            self._process.StartInfo.RedirectStandardError = self.capture_output
            self._process.StartInfo.FileName = self.python
            self._process.StartInfo.Arguments = "-m {0} {1}".format(self.service, self.port)
            self._process.Start()
        else:
            args = [self.python, "-m", self.service, str(self.port)]

            kwargs = dict(env=env)
            print(args)
            if self.capture_output:
                kwargs["stdout"] = PIPE
                kwargs["stderr"] = PIPE
            if self.working_directory:
                kwargs["cwd"] = self.working_directory

            self._process = Popen(args, **kwargs)

    def stop_server(self):
        print("Stopping the server proxy.")
        self._terminate_process()

    def _terminate_process(self):
        """Attempts to terminate the python process hosting the proxy server.

        The process reference might not be present, e.g. in the case
        of reusing an existing connection. In that case, this is a no-op.
        """
        if not self._process:
            return
        try:
            self._process.terminate()
        except Exception:
            pass
        try:
            self._process.kill()
        except Exception:
            pass


api_path = os.path.dirname(ag.__file__)

print(api_path)


def create_api_runner_id(component):
    name = "api-runner"
    return "{}_{}".format(name, component.InstanceGuid)


class ApiRunnerComponent(component):

    def RunScript(self, start, stop, show_window):
        key = create_api_runner_id(self)
        if not show_window:
            show_window = True  # default

        port = DEFAULT_PORT

        if not start:
            return None
        if show_window:
            python = "python"
            capture_output = False
        else:
            python = "pythonw"
            capture_output = True

        if stop:
            self.stop_previous(key)

        if start:
            self.stop_previous(key)
            runner = ApiRunner(python=python, port=port, capture_output=capture_output, working_directory=api_path)
            st[key] = runner

        runner = st[key]

        return runner

    def stop_previous(self, key):
        # stop previous API runner if any
        previous_api_runner = st.get(key)
        if previous_api_runner:
            previous_api_runner.stop_server()
            st.pop(key)
# ---------- end server ----------
reset = Reset(reset=Button())  # inputs reset: Boolean
#   port reset: Set to True to reset.
# ---------- reset: Python ----------
"""Resets the current project running in this Grasshopper file."""
# flake8: noqa

from scriptcontext import sticky as st
from aixd_ara.gh_ui import reset_session
from aixd_ara.gh_ui_helper import session_id, clear_sticky

if reset:
    reset_session(session_id())
    clear_sticky(ghenv, st)
# ---------- end reset ----------
projectsetup = ProjectSetup(set=Button(), project_name=panel_10)  # -> msg, path; inputs set: Boolean
#   port project_root: Path to the project root folder.
#   port project_name: Any name for the project. It will be used to create a folder with the same name in the project root folder. All files will be later saved here.
#   port msg: Messages and errors.
#   port path: Effective path to the project.
# ---------- projectsetup: Python ----------
"""Sets up the project in the folder given by `project_root/project_name`."""
# flake8: noqa
import os

from scriptcontext import sticky as st

from aixd_ara.gh_ui import project_setup
from aixd_ara.gh_ui_helper import clear_sticky
from aixd_ara.gh_ui_helper import component_id
from aixd_ara.gh_ui_helper import session_id

if not project_root:
    ghdoc = ghenv.Component.OnPingDocument().FilePath
    project_root = os.path.dirname(ghdoc)

if project_root and project_name:
    complete_path = os.path.join(project_root, project_name)
    if not os.path.exists(complete_path):
        print("The path {} does not exist and will be now created.".format(complete_path))
        os.mkdir(complete_path)

    cid = component_id(session_id(), ghenv.Component, "ProjectSetup")

    if set:
        clear_sticky(ghenv, st)

        st[cid] = project_setup(session_id(), project_root, project_name)

    if cid in st.keys():
        msg = st[cid]["msg"]
        path = st[cid]["path"]
# ---------- end projectsetup ----------
showfolder = ShowFolder(path=projectsetup.path, open=Button())  # inputs open: Boolean
#   port path: Path to the (local) folder.
#   port open: Set to True to open the folder in the file explorer.
# ---------- showfolder: Python ----------
"""Reveals the folder in the file explorer."""
# flake8: noqa

import os

if open:
    os.startfile(path)
# ---------- end showfolder ----------
panel_11 = Panel(projectsetup.path)
panel_12 = Panel(projectsetup.msg)

# ----
# Generative Design
request = Panel("""length:60
area:1500
displacement:[3,4]""")
generator = Generator(requested_values=request, n_designs="20", generate=Button(), clear=Button(), pick_previous=Button(), pick_next=Button())  # -> sample_summary; inputs requested_values: list, n_designs: Int32, generate: Boolean, clear: Boolean, pick_previous: Boolean, pick_next: Boolean
#   port requested_values: List of requested values, each formatted as a string with the following format: 'variable_name:value'.
# ---------- generator: Python ----------
# flake8: noqa

from scriptcontext import sticky as st

from aixd_ara.gh_ui import get_dataobject_types
from aixd_ara.gh_ui import request_designs
from aixd_ara.gh_ui_helper import component_id
from aixd_ara.gh_ui_helper import instantiate_sample
from aixd_ara.gh_ui_helper import sample_summary as sample_summary_f
from aixd_ara.gh_ui_helper import session_id
from aixd_ara.gh_ui_helper import reformat_request

cid = component_id(session_id(), ghenv.Component, "run_generation")
item = component_id(session_id(), ghenv.Component, "pick_sample")

"""
requested_values: a multiline string with variable_name:values tuples.
"""

if not n_designs or n_designs < 1:
    n_designs = 1

# -------------------------------------------------------------------------------


if clear and cid in st.keys():
    del st[cid]
    st[item] = None
    ghenv.Component.Message = "no samples"

if generate and requested_values:

    variable_types = get_dataobject_types(session_id())["dataobject_types"]

    request_dict = reformat_request(requested_values, variable_types)
    st[item] = 0
    ghenv.Component.Message = "Running"
    st[cid] = request_designs(session_id(), request_dict, n_designs)
    ghenv.Component.Message = "Finished"

if pick_previous:
    st[item] -= 1
if pick_next:
    st[item] += 1

if cid in st.keys():
    samples = st[cid]["generated"]
    n = len(samples)
    i = st[item] % n

    ghenv.Component.Message = "sample {}/{}".format(i + 1, n)

    sample_dict = samples[i]
    ghdoc = ghenv.Component.OnPingDocument()
    instantiate_sample(ghdoc, sample_dict)  # sends design parameter values to the parametric model

    # --- output ---
    sample_summary = "Predicted/Generated:\n--------------------\n\n" + sample_summary_f(sample_dict)
# ---------- end generator ----------
panel_13 = Panel(generator)

# ----
# Plotters
variables = Panel("""area
mass
displacement""")
number_slider = Slider(0.5, range=0.01..1)
txt = Text(variables)
txt_2 = Text(request)
list = ValueList({"interactive", "static"}, selected="static")
list_2 = ValueList({"interactive", "static"}, selected="interactive")
list_3 = ValueList({"interactive", "static"}, selected="interactive")
list_4 = ValueList({"interactive", "static"}, selected="interactive")
plotcorrelations = PlotCorrelations(variables=txt, output_type=list, plot=Button(), scale=number_slider)  # -> img; inputs variables: list, plot: Boolean
#   port variables: List of names of the variables to be plotted.
#   port output_type: Plot type: 'static' creates a bitmap image, 'interactive' launches an interactive plot in a browser.
#   port plot: Set to True to (re-)create the plot.
#   port scale: Resize factor for the static plot.
#   port img: Bitmap image if output_type is 'static', otherwise None.
# ---------- plotcorrelations: Python ----------
"""Plots correlation matrix for the given variables from the data in the dataset."""
# flake8: noqa
from scriptcontext import sticky as st

from aixd_ara.gh_ui import plot_correlations
from aixd_ara.gh_ui_helper import component_id
from aixd_ara.gh_ui_helper import convert_str_to_bitmap
from aixd_ara.gh_ui_helper import session_id

cid = component_id(session_id(), ghenv.Component, "PlotCorrelations")


if plot:
    st[cid] = plot_correlations(
        session_id(), variables, output_type
    )  # if output_type interactive: will launch the plotly fig in browser

if cid in st.keys():
    print(st[cid])
    # TODO: add error msg here
    if output_type == "static" and "imgstr" in st[cid].keys():
        imgstr = st[cid]["imgstr"]
        img = convert_str_to_bitmap(imgstr, scale)
# ---------- end plotcorrelations ----------
plotdistribution = PlotDistribution(variables=txt, output_type=list_2, plot=Button(), scale=number_slider)  # -> img; inputs variables: list, plot: Boolean
#   port variables: List of names of the variables to be plotted.
#   port output_type: Plot type: 'static' creates a bitmap image, 'interactive' launches an interactive plot in a browser.
#   port plot: Set to True to (re-)create the plot.
#   port scale: Resize factor for the static plot.
#   port img: Bitmap image if output_type is 'static', otherwise None.
# ---------- plotdistribution: Python ----------
"""Plots the distribution of the given variables from the data in the dataset."""
# flake8: noqa
from scriptcontext import sticky as st

from aixd_ara.gh_ui import plot_distrib_attributes
from aixd_ara.gh_ui_helper import component_id
from aixd_ara.gh_ui_helper import convert_str_to_bitmap
from aixd_ara.gh_ui_helper import session_id

cid = component_id(session_id(), ghenv.Component, "PlotDistributions")


if plot:
    # if output_type interactive: will launch the plotly fig in browser
    st[cid] = plot_distrib_attributes(session_id(), variables, output_type)

if cid in st.keys():
    print(st[cid])
    # TODO: add error msg here
    if output_type == "static" and "imgstr" in st[cid].keys():
        imgstr = st[cid]["imgstr"]
        img = convert_str_to_bitmap(imgstr, scale)
# ---------- end plotdistribution ----------
plotcontours = PlotContours(variables=txt, output_type=list_3, plot=Button(), scale=number_slider)  # -> img; inputs variables: list, plot: Boolean
#   port variables: List of names of the variables to be plotted.
#   port output_type: Plot type: 'static' creates a bitmap image, 'interactive' launches an interactive plot in a browser.
#   port plot: Set to True to (re-)create the plot.
#   port scale: Resize factor for the static plot.
#   port img: Bitmap image if output_type is 'static', otherwise None.
# ---------- plotcontours: Python ----------
"""Plots the distribution contours for each pair of variables from the data in the dataset."""
# flake8: noqa
from scriptcontext import sticky as st

from aixd_ara.gh_ui import plot_contours
from aixd_ara.gh_ui_helper import component_id
from aixd_ara.gh_ui_helper import convert_str_to_bitmap
from aixd_ara.gh_ui_helper import session_id

cid = component_id(session_id(), ghenv.Component, "PlotContours")


if plot:
    st[cid] = plot_contours(session_id(), variables, output_type) # if output_type interactive: will launch the plotly fig in browser

if cid in st.keys():
    print st[cid]
    #TODO: add error msg here
    if output_type == "static" and 'imgstr' in st[cid].keys():
        imgstr = st[cid]['imgstr']
        img = convert_str_to_bitmap(imgstr, scale)
# ---------- end plotcontours ----------
plotcontreq = PlotContoursRequest(request=txt_2, output_type=list_4, plot=Button(), scale=number_slider)  # -> img; inputs request: list, plot: Boolean
#   port request: List of requested values, each formatted as a string with the following format: 'variable_name:value'.
#   port output_type: Plot type: 'static' creates a bitmap image, 'interactive' launches an interactive plot in a browser.
#   port plot: Set to True to (re-)create the plot.
#   port scale: Resize factor for the static plot.
#   port img: Bitmap image if output_type is 'static', otherwise None.
# ---------- plotcontreq: Python ----------
"""Plots the requested and predicted values against the distribution contours for each pair of the corresponding variables."""
# flake8: noqa
from scriptcontext import sticky as st
from aixd_ara.gh_ui import plot_contours_request
from aixd_ara.gh_ui import get_dataobject_types
from aixd_ara.gh_ui_helper import session_id
from aixd_ara.gh_ui_helper import component_id
from aixd_ara.gh_ui_helper import convert_str_to_bitmap
from aixd_ara.gh_ui_helper import reformat_request


cid = component_id(session_id, ghenv.Component, "create_dataset_object")

n_samples = 3

if plot:
    variable_types = get_dataobject_types(session_id())["dataobject_types"]
    request_dict = reformat_request(request, variable_types)
    print request_dict
    st[cid] = plot_contours_request(session_id(), request_dict, n_samples, output_type) # if output_type interactive: will launch the plotly fig in browser

if cid in st.keys():
    print st[cid]
    #TODO: add error msg here
    if output_type == "static" and 'imgstr' in st[cid].keys():
        imgstr = st[cid]['imgstr']
        img = convert_str_to_bitmap(imgstr, scale)
# ---------- end plotcontreq ----------
img = PrevImage(SmartBitmap=plotcorrelations)

# ----
# Credits:
# Aleksandra Anna Apolinarska (ETH Zurich, 2024)
# 
# Adopted from: https://karamba3d.com/examples/shell-cross-section-optimization/
# 
# Dependencies:
# * Karamba3D
# * Bitmap+
# Parametric Model
dp_span = Number(67.95739746)
dp_ws_ratio1 = Number(0.08798836172)
dp_ws_ratio2 = Number(1.46901989)
dp_hs_ratio1 = Number(0.1552468538)
dp_hs_ratio2 = Number(2.769116402)
parametric_model = ParametricModel(span=dp_span, ws_ratio1=dp_ws_ratio1, ws_ratio2=dp_ws_ratio2, hs_ratio1=dp_hs_ratio1, hs_ratio2=dp_hs_ratio2)  # -> srf_brep_2, karamba_mesh_2, length_2, area_3, mass_2, displacement_2
geo = Geometry(parametric_model.karamba_mesh_2)
pa_length = Number(parametric_model.length_2)
pa_mass = Number(parametric_model.mass_2)
pa_displacement = Number(parametric_model.displacement_2)
pa_area = Number(parametric_model.area_3)
m_2 = Panel(pa_length)
kg = Panel(pa_mass)
m2 = Panel(pa_area)
cm = Panel(pa_displacement)

features = Panel("""ws_ratio1
ws_ratio2
hs_ratio1
hs_ratio2""")
targets = Panel("""span
area
displacement
mass""")

# ----
# Autoencoder Model
# set up a new model
# run training
# load a trained model
# model summary
number_slider_2 = Slider(2, range=1..5)
load_model = Button()
train = Button()
panel_14 = Panel("""16
64
256
64
16""")
modelsetup = ModelSetup(inputML=features, outputML=targets, latent_dim="3", hidden_layers=panel_14, batch_size="1024", set=Button())  # -> quick_summary, model_dims; inputs inputML: list, outputML: list, latent_dim: Int32, hidden_layers: list of Int32, batch_size: Int32, set: Boolean
#   port model_type: Type of the autoencoder model. Options are: 'CAE' (conditional Autoencoder) and 'CVAE' (conditional Variational Autoencoder). Default: 'CAE'.
#   port inputML: List of variable names to be used as input to the model.
#   port outputML: List of variable names to be used as output from the model.
#   port latent_dim: Dimension of the latent space.
#   port hidden_layers: Width of each hidden layer (list of int).
#   port batch_size: Size of the training batches
#   port set: Set to True to set up the model.
#   port quick_summary: Quick summary of the model.
#   port model_dims: Input and output dimensions of the model.
# ---------- modelsetup: Python ----------
"""Sets up an autoencoder model of the specified type with the given parameters."""
# flake8: noqa
from scriptcontext import sticky as st

from aixd_ara.gh_ui import model_setup
from aixd_ara.gh_ui_helper import component_id
from aixd_ara.gh_ui_helper import session_id

cid = component_id(session_id(), ghenv.Component, "ModelSetup")

settings = {
    "model_type": model_type,
    "inputML": inputML,
    "outputML": outputML,
    "latent_dim": latent_dim,
    "hidden_layers": hidden_layers,
    "batch_size": batch_size,
}


# TODO: make default settings a bit more smart
default_settings = {
    "model_type": "CAE",
    "inputML": "design_parameters",
    "outputML": "performance_attributes",
    "latent_dim": 8,
    "hidden_layers": [512, 256, 128, 64],
    "batch_size": 16,
}

for k in default_settings.keys():
    if (k not in settings) or (k in settings and settings[k] == None) or (k in settings and settings[k] == []):
        settings[k] = default_settings[k]
        print(k, default_settings[k])


if set:
    st[cid] = model_setup(session_id(), settings)


if cid in st.keys():
    quick_summary = st[cid]["quick_summary"]["summary"]
    model_dims = st[cid]["model_dims"]["summary"]
    ghenv.Component.Message = st[cid]["msg"]
# ---------- end modelsetup ----------
modeltrain = ModelTrain(epochs="100", run=train)  # -> best_ckpt, path; inputs epochs: Int32, run: Boolean
#   port epochs: Number of training epochs.
#   port wb: Weights&Biases: username or team name. If not set, W&B will not be used.
#   port run: Set to True to start training.
#   port best_ckpt: Filename of the best performing checkpoint.
#   port path: Path to all checkpoints.
# ---------- modeltrain: Python ----------
"""Runs a training campaign."""
# flake8: noqa

from scriptcontext import sticky as st

from aixd_ara.gh_ui import model_train
from aixd_ara.gh_ui import project_setup_info
from aixd_ara.gh_ui_helper import component_id
from aixd_ara.gh_ui_helper import session_id

cid = component_id(session_id(), ghenv.Component, "ModelTrain")


if not epochs or epochs < 1:
    epochs = 1

if wb:
    import webbrowser

    if run:
        projectname = project_setup_info(session_id())["project_name"]
        url = "https://wandb.ai/{}/{}".format(wb, projectname)
        webbrowser.open(url)
        # TODO: check login and add interface to login if needed


if run:
    st[cid] = model_train(session_id(), epochs, wb)


if cid in st.keys():
    best_ckpt = st[cid]["best_ckpt"]
    path = st[cid]["path"]
    ghenv.Component.Message = st[cid]["msg"]
else:
    ghenv.Component.Message = ""

# TODO:
# * return path or name of best checkpoint
# * make non-GUI-blocking
# * display progress
# ---------- end modeltrain ----------
modelload = ModelLoad(load=load_model)  # -> msg; inputs load: Boolean
#   port model_type: Type of the autoencoder model. Options are: 'CAE' (conditional Autoencoder) and 'CVAE' (conditional Variational Autoencoder). Default: 'CAE'.
#   port checkpoint_name: Name of the checkpoint file to load the model from, without the file extension. The file's extension must be .ckpt
#   port checkpoint_path: Path to the directory containing the checkpoint file.
#   port load: Set to True to load the model.
#   port msg: Confirmation of the model loading, or an error message.
# ---------- modelload: Python ----------
"""Loads an existing, pre-traind neural network model from a checkpoint."""
# flake8: noqa
from scriptcontext import sticky as st

from aixd_ara.gh_ui import model_load
from aixd_ara.gh_ui_helper import component_id
from aixd_ara.gh_ui_helper import session_id

cid = component_id(session_id(), ghenv.Component, "ModelLoad")

if not model_type:
    model_type = "CAE"
if not checkpoint_path:
    checkpoint_path = ""
if not checkpoint_name:
    checkpoint_name = "last"

if load:
    st[cid] = model_load(session_id(), model_type, checkpoint_name, checkpoint_path)

if cid in st.keys():
    msg = st[cid]["msg"]
# ---------- end modelload ----------
modeldims = ModelDimensions(get=Button())  # -> summary; inputs get: Boolean
#   port get: Set to True to retrieve input and output dimensions of the model.
#   port summary: Summary of the model's input and output dimensions.
# ---------- modeldims: Python ----------
"""Retrieves dimensions of the model's input and output layers."""
# flake8: noqa
from scriptcontext import sticky as st

from aixd_ara.gh_ui import model_input_output_dimensions
from aixd_ara.gh_ui_helper import component_id
from aixd_ara.gh_ui_helper import session_id

cid = component_id(session_id(), ghenv.Component, "ModelDims")

if get:
    st[cid] = model_input_output_dimensions(session_id())

if cid in st.keys():
    summary = st[cid]["summary"]
# ---------- end modeldims ----------
modelsummary = ModelSummary(max_depth=number_slider_2, get=Button())  # -> summary; inputs max_depth: Int32, get: Boolean
#   port max_depth: Sets the depth of the summary. The larger the depth, the more detailed the summary.
#   port get: Retrieves the model information.
#   port summary: Model summary.
# ---------- modelsummary: Python ----------
"""Provides a summary of the autoencoder model's architecture."""
# flake8: noqa
from scriptcontext import sticky as st

from aixd_ara.gh_ui import nn_summary
from aixd_ara.gh_ui_helper import component_id
from aixd_ara.gh_ui_helper import session_id

cid = component_id(session_id(), ghenv.Component, "ModelSummary")


if not max_depth:
    max_depth = 1

if get:
    st[cid] = nn_summary(session_id(), max_depth)

if cid in st.keys():
    summary = st[cid]["summary"]
# ---------- end modelsummary ----------
showfolder_2 = ShowFolder(path=modeltrain.path, open=Button())  # inputs open: Boolean; same code as showfolder
panel_15 = Panel(modelload)
panel_16 = Panel([modeldims, modelsummary])

# ==== cluster ParametricModel

# ----
# INPUTS
# Design Parameters
span = ClusterInput()
ws_ratio1 = ClusterInput()
ws_ratio2 = ClusterInput()
hs_ratio1 = ClusterInput()
hs_ratio2 = ClusterInput()

python = GhPythonScript(span=span, ws_ratio1=ws_ratio1, ws_ratio2=ws_ratio2, hs_ratio1=hs_ratio1, hs_ratio2=hs_ratio2)  # -> out, crvs
# ---------- python: Python ----------
import Rhino.Geometry as rg


x = span*0.5
y1 = ws_ratio1*span*0.5
y2 = y1*ws_ratio2
z1 = hs_ratio1*span
z2 = z1*hs_ratio2

ptsA = [rg.Point3d(-x, y1,0),
        rg.Point3d(0,y2,z2),
        rg.Point3d(x,y1,0)]

ptsB = [rg.Point3d(-x,0,0),
        rg.Point3d(0,0,z1),
        rg.Point3d(x,0,0)
        ]
        

ptsC = [rg.Point3d(-x, -y1,0),
        rg.Point3d(0,-y2,z2),
        rg.Point3d(x,-y1,0)]

crvA = rg.Curve.CreateControlPointCurve(ptsA, degree=2)
crvB = rg.Curve.CreateControlPointCurve(ptsB, degree=2)
crvC = rg.Curve.CreateControlPointCurve(ptsC, degree=2)


#crvA = rg.Curve.CreateInterpolatedCurve(ptsA, degree=2)
#crvB = rg.Curve.CreateInterpolatedCurve(ptsB, degree=2)
#crvC = rg.Curve.CreateInterpolatedCurve(ptsC, degree=2)


crvs = [crvA, crvB,crvC]
# ---------- end python ----------
loft = Loft(Curves=python.crvs, Options={Adjust=False, Closed=False, LoftEnds=0, LoftSimp=0, LoftType=0, Rebuild=10, Refit=0.01})
flip = Flip(Surface=loft)  # -> Surface, Result
geo = Geometry(loft)
mesh_uv = MeshSurface(Surface=geo, UCount=Slider(3, range=1..20), VCount=Slider(8, range=1..20), Overhang=True, Equalize=False)
tri = Triangulate(Mesh=mesh_uv)  # -> Mesh, Count
mesh = Mesh(tri.Mesh)
mesh_2 = Mesh(mesh)
res = Slider(1, range=0.5..6)
brep = Brep(geo)

# ---- group: Define Materials
matselect = MaterialSelectionKaramba3D(menu=[dropdown(9), dropdown(19)])

# ---- group: define cross sections
range = Range(Domain="10 to 110", Steps=20)
expression = Expression(x="Shell", y=range, Expression="x&\" \"&y")
cross_section = CrossSectionKaramba3D(
    FamilyNameOfCrossSection="Shell",
    NameOfCrossSection=graft(expression),
    Material=matselect,
    Height_cm=graft(range),
    mode="Shell - Const")  # -> flatten(CrossSection)
crosecselect = CrossSectionSelectorKaramba3D(CrossSections=cross_section, ElementsIdentifiers="S")  # -> CrossSection, Info

# ----
dom²num = ConstructDomain²(UMin="0.25", UMax="0.75", VMin="0", VMax="1")

# ---- group: Define Loads
dom²num_2 = ConstructDomain²(UMin="0", UMax="1", VMin="0.25", VMax="0.75")
subsrf = Isotrim(Surface=reparameterize(brep), Domain=dom²num)
Z = UnitZ(Factor="-10")
mesh_breps = MeshBreps(
    Brep=subsrf,
    MeshResolution=0.5,
    EdgeRefinementFactor=0.67,
    PointReduction=False,
    SmoothingStepSize=0,
    SmoothingIterations=5)  # -> Mesh, Info
loads = LoadsKaramba3D(Vector=Vector(0, 0, -1), LCase="0", mode="Gravity")
loads_2 = LoadsKaramba3D(Vector=Z, Mesh=mesh_breps.Mesh, LCase="0", mode="MeshLoad -Const.", menu=[buttons(on, off, off), buttons(on, on)])
load = LoadKaramba3D(flatten([loads, loads_2]))

# ---- group: Define Elements
meshtoshell = MeshToShellKaramba3D(Mesh=mesh_2, Identifier="S", CrossSection=crosecselect.CrossSection, LimitDistance_m=0.005)  # -> Element, Points, Info

# ---- group: Define Supports
panel = Panel("""{1,0,0}
{1,1,0}""")
panel_2 = Panel("""{0,0,0}
{0,1,0}""")
evalsrf = EvaluateSurface(Surface=reparameterize(brep), Point=panel)  # -> Point, Normal, UDirection, VDirection, Frame
evalsrf_2 = EvaluateSurface(Surface=reparameterize(brep), Point=panel_2)  # -> Point, Normal, UDirection, VDirection, Frame
pline = PolyLine(Vertices=evalsrf.Point, Closed=False)
pline_2 = PolyLine(Vertices=evalsrf_2.Point, Closed=False)
pt = Point(meshtoshell.Points)
pt_2 = Point(meshtoshell.Points)
pull = PullPoint(Point=pt, Geometry=pline, ClosestOnly=True)  # -> ClosestPoint, Distance
pull_2 = PullPoint(Point=pt_2, Geometry=pline_2, ClosestOnly=True)  # -> ClosestPoint, Distance
smaller = SmallerThan(FirstNumber=pull.Distance, SecondNumber=0.01)  # -> SmallerThan, OrEqualTo
smaller_2 = SmallerThan(FirstNumber=pull_2.Distance, SecondNumber=0.01)  # -> SmallerThan, OrEqualTo
cull = CullPattern(List=pt, CullPattern=smaller.SmallerThan)
cull_2 = CullPattern(List=pt_2, CullPattern=smaller_2.SmallerThan)
supp = SupportKaramba3D(PosInd=cull, menu=[buttons(on, on, on, off, off, off)])
supp_2 = SupportKaramba3D(PosInd=cull_2, menu=[buttons(on, on, on, off, off, off)])

# ---- group: Create Geometry
res_2 = Slider(6, range=0.5..10)
pt_3 = Point([Point(-30.29866546, -3.508493978, 0), Point(-30.29866546, -1.169497993, 0), Point(-30.29866546, 1.169497993, 0), Point(-30.29866546, 3.508493978, 0), Point(-19.80304532, -5.223412372, 3.46494229), Point(-19.80304532, -3.301380148, 0.2402272391)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])
panel_3 = Panel("""{0,0,0}
{0.125,0.25,0}
{0.25,0.5,0}
{0.375,0.75,0}
{0.5,1,0}
{0.625,1,0}
{0.75,1,0}
{0.875,1,0}
{1,1,0}""")
srfgrid = SurfaceFromPoints(Points=pt_3, UCount="6", Interpolate=False)
item = ListItem(List=[evalsrf.Point, evalsrf_2.Point], Index=0, Wrap=True)  # -> Item, Item1, Item2, Item3
aligndim = AlignedDimension(
    Plane=PlaneXY(0, 0, 0),
    PointA=[item.Item, item.Item2],
    PointB=[item.Item2, item.Item3],
    Offset=Slider(4.2, range=0..10),
    Text="{0:0.00}",
    Size=Slider(0.7, range=0..1))
iso = IsoCurve(Surface=reparameterize(brep), UVPoint=panel_3)  # -> UIsocurve, VIsocurve
# 02 - Shell Cross Section Optimization
# Difficulty: Simple (TRIAL/PRO versions only)
# The cross sections of a concrete shell bridge with an arc form are optimized. A mesh load runs along the center of the bridge. Custom colours can be plugged into the ModelViewer for the mesh preview.
# To view in the TRIAL version, set the Mesh Resolution to 6 and the Edge Refinement Factor to 1.
mesh_breps_2 = MeshBreps(
    Brep=brep,
    MeshResolution=res_2,
    EdgeRefinementFactor=res,
    PointReduction=True,
    SmoothingStepSize=0.8,
    SmoothingIterations=5)  # -> Mesh, Info

# ---- group: Assemble Model
assemble = AssembleModelKaramba3D(Elem=flatten(meshtoshell.Element), Support=flatten([supp, supp_2]), Load=flatten(load), LimitDistance_m=0.005)  # -> Model, Info, Mass_kg, CenterOfGravity, LoadCaseNames

# ----
panel_4 = Panel(assemble.Mass_kg)

# ---- group: Optimize Cross Sections
opticrosec = OptimizeCrossSectionKaramba3D(
    Model=assemble.Model,
    CrossSections=cross_section,
    MaximumUtilization=1,
    MaximumDisplacement_cm="1",
    UltimateLimitStateIterations=5,
    DisplacementIterations=5,
    NumberOfSamplePoints=3,
    ElasticDesign=True,
    GammaM0=1,
    GammaM1=1.1,
    SwayFrame=True)  # -> ModelWithOptimizedCrossSections, Info, Mass_kg, MaximumDisplacement_cm, ElasticEnergy_kNm
panel_5 = Panel(opticrosec.MaximumDisplacement_cm)

# ---- group: Analyze Model - FREE VERSION
analyzethii = AnalyzeThIIKaramba3D(Model=assemble.Model, RTolerance=1e-07, MaxIterations=50, NoTensionalNII=False)  # -> CalculatedModel, MaximumDisplacement_cm, ResultingForceOfGravity_kN, ElasticEnergy_kNm
panel_6 = Panel(analyzethii.MaximumDisplacement_cm)

# ----
panel_7 = Panel(opticrosec.Mass_kg)
panel_8 = Panel(opticrosec.Info)

# ---- group: View Results
modelview = ModelViewKaramba3D(Model=opticrosec.ModelWithOptimizedCrossSections, ResultFactors=1, ResultCase=-1)  # -> Model, DeformedMesh, DeformedAxes, DeformedModel
shellview = ShellViewKaramba3D(Model=modelview.Model, IndexOfLayer=0)  # -> Model, MeshesOfRenderedShells, LegendColors, LegendTags
legend = Legend(Colour=shellview.LegendColors, Tags=shellview.LegendTags, LegendType=1)

# ----
area = Area(Geometry=mesh_2)  # -> Area, Centroid
python_2 = GhPythonScript(x=modelview.Model)  # -> out, calc_ok; disabled
# ---------- python_2: Python ----------
if not x: calc_ok = False
else: calc_ok = True
# ---------- end python_2 ----------

# ----
# OUTPUTS
# Geometry
# Performance Attributes
mass = Number(opticrosec.Mass_kg)
srf_brep = Brep(brep)
karamba_mesh = Mesh(shellview.MeshesOfRenderedShells)
length = Number(span)
area_2 = Number(area.Area)
displacement = Number(opticrosec.MaximumDisplacement_cm)
srf_brep_2 = ClusterOutput(srf_brep)
karamba_mesh_2 = ClusterOutput(karamba_mesh)
length_2 = ClusterOutput(length)
area_3 = ClusterOutput(area_2)
mass_2 = ClusterOutput(mass)
displacement_2 = ClusterOutput(displacement)
